# Grasshopper definition 3DMazeGen.gh (Grasshopper 1.0.7)

maze_size = Slider(3.5, range=1..5)
no_of_rows = Slider(10, range=5..25)
no_of_cols = Slider(10, range=5..25)
no_of_layers = Slider(10, range=5..25)
c_script = CSharpScript(width=maze_size, rows=no_of_rows, cols=no_of_cols, layers=no_of_layers)  # -> out, A; inputs width: Double, rows: Int32, cols: Int32, layers: Int32
# ---------- c_script: C# usings ----------
using System.IO;
using System.Linq;
using System.Data;
using System.Drawing;
using System.Reflection;
using System.Windows.Forms;
using System.Xml;
using System.Xml.Linq;
using System.Runtime.InteropServices;

using Rhino.DocObjects;
using Rhino.Collections;
using GH_IO;
using GH_IO.Serialization;
# ---------- c_script: C# ----------
//Global variables
List<Cell> grid = new List<Cell>();
Cell current;
Stack<Cell> cellStack = new Stack<Cell>();

//Creating grid of cells
for(int k = 0; k < layers; k++) {
    for(int j = 0; j < rows; j++) {
        for(int i = 0; i < cols; i++) {
            Cell node = new Cell(i, j, k, width, rows, cols);
            grid.Add(node);
        }
    }
}

current = grid[0];

//check
Cell next = current.checkNeighbors(grid);
removeWalls(current, next);
A = next.show();

//Setting the current cell at the beginning of grid
# ---------- c_script: C# additional code ----------
public class Cell
{
    public int i, j, k, rows, cols;
    public double w, x, y, z;
    public bool[] walls = {true, true, true, true, true, true};
    public bool visited = false;

    //Constructor
    public Cell(int i, int j, int k, double w, int rows, int cols)
    {
        this.i = i;
        this.j = j;
        this.k = k;
        this.w = w;
        this.rows = rows;
        this.cols = cols;
    }

    public Cell checkNeighbors(List<Cell> grid)
    {
        List<Cell> neighbors = new List<Cell>();
        Cell top, bottom, left, right, up, down;

        try {
            top = grid[this.index(this.i, this.j + 1, this.k)];
        } catch {
            top = null;
        }
        try {
            right = grid[this.index(this.i + 1, this.j, this.k)];
        } catch {
            right = null;
        }
        try {
            bottom = grid[this.index(this.i, this.j - 1, this.k)];
        } catch {
            bottom = null;
        }
        try {
            left = grid[this.index(this.i - 1, this.j, this.k)];
        } catch {
            left = null;
        }
        try {
            up = grid[this.index(this.i, this.j, this.k + 1)];
        } catch {
            up = null;
        }
        try {
            down = grid[this.index(this.i, this.j, this.k - 1)];
        } catch {
            down = null;
        }

        if (!(top == null) && !top.visited) {
            neighbors.Add(top);
        }
        if (!(right == null) && !right.visited) {
            neighbors.Add(right);
        }
        if (!(bottom == null) && !bottom.visited) {
            neighbors.Add(bottom);
        }
        if (!(left == null) && !left.visited) {
            neighbors.Add(left);
        }
        if (!(up == null) && !up.visited) {
            neighbors.Add(up);
        }
        if (!(down == null) && !down.visited) {
            neighbors.Add(down);
        }

        if (neighbors.Count > 0) {
            int index = new Random().Next(neighbors.Count);
            return neighbors[index];
        } else {
            return null;
        }
    }

    public Box highlight()
    {
        Interval wInterval = new Interval(-this.w/2.0, this.w/2.0);
        Plane p = Plane.WorldXY;
        Box highlightBox = new Box(p, wInterval, wInterval, wInterval);
        return highlightBox;
    }

    public int index(int i, int j, int k)
    {
        return (k * rows * cols) + (j * cols) + i;
    }

    public List<Brep> show()
    {
        this.x = (double)this.i * this.w;
        this.y = (double)this.j * this.w;
        this.z = (double)this.k * this.w;

        List<Brep> wallBrep = new List<Brep>();

        if (this.walls[0]) {
            wallBrep.Add(Brep.CreateFromCornerPoints(
              new Point3d(this.x - (this.w/2.0), this.y - (this.w/2.0), this.z + (this.w/2.0)),
              new Point3d(this.x - (this.w/2.0), this.y + (this.w/2.0), this.z + (this.w/2.0)),
              new Point3d(this.x - (this.w/2.0), this.y + (this.w/2.0), this.z - (this.w/2.0)),
              new Point3d(this.x - (this.w/2.0), this.y - (this.w/2.0), this.z - (this.w/2.0)), 0.01
            ));
        }
        if (this.walls[1]) {
            wallBrep.Add(Brep.CreateFromCornerPoints(
              new Point3d(this.x + (this.w/2.0), this.y - (this.w/2.0), this.z + (this.w/2.0)),
              new Point3d(this.x + (this.w/2.0), this.y + (this.w/2.0), this.z + (this.w/2.0)),
              new Point3d(this.x + (this.w/2.0), this.y + (this.w/2.0), this.z - (this.w/2.0)),
              new Point3d(this.x + (this.w/2.0), this.y - (this.w/2.0), this.z - (this.w/2.0)), 0.01
            ));
        }
        if (this.walls[2]) {
          wallBrep.Add(Brep.CreateFromCornerPoints(
              new Point3d(this.x + (this.w/2.0), this.y - (this.w/2.0), this.z + (this.w/2.0)),
              new Point3d(this.x - (this.w/2.0), this.y - (this.w/2.0), this.z + (this.w/2.0)),
              new Point3d(this.x - (this.w/2.0), this.y - (this.w/2.0), this.z - (this.w/2.0)),
              new Point3d(this.x + (this.w/2.0), this.y - (this.w/2.0), this.z - (this.w/2.0)), 0.01
            ));
        }
        if (this.walls[3]) {
          wallBrep.Add(Brep.CreateFromCornerPoints(
              new Point3d(this.x + (this.w/2.0), this.y + (this.w/2.0), this.z + (this.w/2.0)),
              new Point3d(this.x - (this.w/2.0), this.y + (this.w/2.0), this.z + (this.w/2.0)),
              new Point3d(this.x - (this.w/2.0), this.y + (this.w/2.0), this.z - (this.w/2.0)),
              new Point3d(this.x + (this.w/2.0), this.y + (this.w/2.0), this.z - (this.w/2.0)), 0.01
            ));
        }
        if (this.walls[4]) {
          wallBrep.Add(Brep.CreateFromCornerPoints(
              new Point3d(this.x - (this.w/2.0), this.y - (this.w/2.0), this.z + (this.w/2.0)),
              new Point3d(this.x - (this.w/2.0), this.y + (this.w/2.0), this.z + (this.w/2.0)),
              new Point3d(this.x + (this.w/2.0), this.y + (this.w/2.0), this.z + (this.w/2.0)),
              new Point3d(this.x + (this.w/2.0), this.y - (this.w/2.0), this.z + (this.w/2.0)), 0.01
            ));
        }
        if (this.walls[5]) {
          wallBrep.Add(Brep.CreateFromCornerPoints(
              new Point3d(this.x - (this.w/2.0), this.y - (this.w/2.0), this.z - (this.w/2.0)),
              new Point3d(this.x - (this.w/2.0), this.y + (this.w/2.0), this.z - (this.w/2.0)),
              new Point3d(this.x + (this.w/2.0), this.y + (this.w/2.0), this.z - (this.w/2.0)),
              new Point3d(this.x + (this.w/2.0), this.y - (this.w/2.0), this.z - (this.w/2.0)), 0.01
            ));
        }

        if (this.visited) {
          return null;
        }

        if (wallBrep.Count > 0) {
            return wallBrep;
        }
        return null;
    }
}

//Function that removes the wall between two input cells
public void removeWalls(Cell a, Cell b)
{
    int x = a.i - b.i;

    if (x == 1) {
        a.walls[2] = false;
        b.walls[3] = false;
    } else if (x == -1) {
        a.walls[3] = false;
        b.walls[2] = false;
    }

    int y = a.j - b.j;

    if (y == 1) {
        a.walls[1] = false;
        b.walls[0] = false;
    } else if (y == -1) {
        a.walls[0] = false;
        b.walls[1] = false;
    }

    int z = a.k - b.k;

    if (z == 1) {
        a.walls[5] = false;
        b.walls[4] = false;
    } else if (z == -1) {
        a.walls[4] = false;
        b.walls[5] = false;
    }
}
# ---------- end c_script ----------
panel = Panel(c_script.A)
